# Dynamo graph copy_from_excel.dyn "kopiowanie do projektu z excela" (Dynamo 3.6.1.9895)

# group: read
# Opis <Kliknij dwukrotnie tutaj, aby edytować opis grupy>
file_path = Filename(".\revitdatas.xlsx")
string = StringInput("room data")
boolean = BoolSelector(true)
openXMLImportExcel = Data.OpenXMLImportExcel(filePath=file_path, sheetName=string, readAsString=boolean)

# group: reorganize
# data fo revit rooms
transpose = List.Transpose(lists=openXMLImportExcel)
code_block = CodeBlock { 0; 1; }
# note: id
getItemAtIndex = List.GetItemAtIndex(list=transpose, index=code_block.out0)
# note: room names
getItemAtIndex_2 = List.GetItemAtIndex(list=transpose, index=code_block.out1)

# group: update
# room names
element_by_id = ElementById(Id=getItemAtIndex)
string_2 = StringInput("Nazwa")
setParameterByName = Element.SetParameterByName(element=element_by_id, parameterName=string_2, value=getItemAtIndex_2)
