# Dynamo graph create pipeline dynamo+python custom module.dyn (Dynamo 3.6.1.9895)
# packages: Data-Shapes 2026.4.2

# group: input
# Opis <Kliknij dwukrotnie tutaj, aby edytować opis grupy>
element_classes = ElementTypes("PipingSystemType")
element_classes_2 = ElementTypes("PipeType")
wybór_linni = DSModelElementsSelection()  # 6 picked in the model; graph input

all_elements_of_class = ElementsOfType(element_class=element_classes)
code_block = CodeBlock(l=all_elements_of_class) { l[0]; }
all_elements_of_class_2 = ElementsOfType(element_class=element_classes_2)
python_script = Python(IN[0]=all_elements_of_class_2)  # CPython3
# ---------- python_script.python (42 lines) ----------
# -*- coding: utf-8 -*-
import clr

# Importujemy Revit API, żeby wyciągnąć parametry nazw
clr.AddReference('RevitAPI')
from Autodesk.Revit.DB import *

def force_unwrap(item):
    """Funkcja do odpakowania elementów z formatu Dynamo do Revit API"""
    if item is None: return None
    if hasattr(item, "InternalElement"): 
        return item.InternalElement
    return item

# 1. Pobieramy obiekty z wejścia IN[0] (podłącz tutaj 'All Elements of Class')
input_data = IN[0] if isinstance(IN[0], list) else [IN[0]]
elements = [force_unwrap(x) for x in input_data]

names = []
clean_elements = []

for el in elements:
    if el is None: continue
    try:
        # Próbujemy pobrać "Nazwę typu" (Symbol Name)
        p = el.get_Parameter(BuiltInParameter.SYMBOL_NAME_PARAM)
        n = p.AsString() if p and p.AsString() else el.Name
        
        # Jeśli nazwa jest pusta, używamy domyślnego .Name
        if not n: n = "Nieznany typ"
        
        names.append(n)
        clean_elements.append(el)
    except:
        # Jeśli coś pójdzie nie tak, bierzemy co się da
        names.append(str(el.Id))
        clean_elements.append(el)

# 2. WYJŚCIE:
# OUT[0] to lista nazw (podłącz do 'keys' w UI.DropDown.Data)
# OUT[1] to lista fizycznych obiektów (podłącz do 'values' w UI.DropDown.Data)
OUT = [names, clean_elements]
# ----------------------------------------
code_block_2 = CodeBlock { 0; }
getItemAtIndex = List.GetItemAtIndex(list=python_script, index=code_block_2)
code_block_3 = CodeBlock { 1; }
getItemAtIndex_2 = List.GetItemAtIndex(list=python_script, index=code_block_3)
dropdown_data = Custom[DropDown Data](Keys=getItemAtIndex, Values=getItemAtIndex_2)  # package Data-Shapes; Create data for DropDown input in UI.MultiInputForm ++ . Check out www.data-shapes.net for more infos.
code_block_4 = CodeBlock { "true"; }
multipleinputform = Custom[MultipleInputForm ++](Inputs=dropdown_data, Toggle=code_block_4)  # package Data-Shapes; Create a form with multiple inputs. see www.data-shapes.net for tutorials and infos!
firstItem = List.FirstItem(list=multipleinputform.User_Inputs)
python_script_2 = Python(IN[0]=code_block, IN[1]=firstItem, IN[2]=wybór_linni)  # CPython3
# ---------- python_script_2.python (178 lines) ----------
# -*- coding: utf-8 -*-
import clr
import math

clr.AddReference('RevitAPI')
from Autodesk.Revit.DB import *
from Autodesk.Revit.DB.Plumbing import *

clr.AddReference('RevitServices')
import RevitServices
from RevitServices.Persistence import DocumentManager

doc = DocumentManager.Instance.CurrentDBDocument

# --- WEJŚCIA ---
raw_system = IN[0]
raw_type = IN[1]
raw_elements = IN[2] if isinstance(IN[2], list) else [IN[2]]

raport = []

# --- FUNKCJE POMOCNICZE ---

def force_unwrap(item):
    if item is None: return None
    if hasattr(item, "InternalElement"): return item.InternalElement
    return item

def get_line_intersection_2d(p1, p2, p3, p4):
    den = (p4.Y - p3.Y) * (p2.X - p1.X) - (p4.X - p3.X) * (p2.Y - p1.Y)
    if den == 0: return None 
    ua = ((p4.X - p3.X) * (p1.Y - p3.Y) - (p4.Y - p3.Y) * (p1.X - p3.X)) / den
    ub = ((p2.X - p1.X) * (p1.Y - p3.Y) - (p2.Y - p1.Y) * (p1.X - p3.X)) / den
    if 0.01 < ua < 0.99 and 0.01 < ub < 0.99:
        return XYZ(p1.X + ua * (p2.X - p1.X), p1.Y + ua * (p2.Y - p1.Y), 0)
    return None

def dist_pt_to_line_2d(p, a, b):
    area = abs((b.Y - a.Y) * p.X - (b.X - a.X) * p.Y + b.X * a.Y - b.Y * a.X)
    line_len = math.sqrt((b.Y - a.Y)**2 + (b.X - a.X)**2)
    return area / line_len if line_len > 0 else 0

def get_conn(p_obj, pt):
    if not p_obj: return None
    for c in p_obj.ConnectorManager.Connectors:
        if c.Origin.DistanceTo(pt) < 0.5: return c
    return None

# --- LOGIKA ANALIZY ---

def analyze_intersections(data_list):
    L, T, X = [], [], []
    tol = 0.06 # ok. 2 cm (tolerancja styku)
    height_limit = 1.0 # ok. 30 cm (limit odległości pionowej rur od siebie)

    for i in range(len(data_list)):
        for j in range(i + 1, len(data_list)):
            l1, l2 = data_list[i]["curve"], data_list[j]["curve"]
            p1s, p1e = l1.GetEndPoint(0), l1.GetEndPoint(1)
            p2s, p2e = l2.GetEndPoint(0), l2.GetEndPoint(1)

            # --- NOWY FILTR: Sprawdzenie wysokości ---
            # Liczymy średnie Z dla obu linii
            z1_avg = (p1s.Z + p1e.Z) / 2
            z2_avg = (p2s.Z + p2e.Z) / 2
            
            # Jeśli rury są od siebie oddalone w pionie o więcej niż limit, pomiń
            if abs(z1_avg - z2_avg) > height_limit:
                continue
            # ------------------------------------------

            # 1. SPRAWDZAMY CZWÓRNIK (X)
            cross_pt = get_line_intersection_2d(p1s, p1e, p2s, p2e)
            if cross_pt:
                z_avg = (z1_avg + z2_avg) / 2
                X.append({"id_a": data_list[i]["id"], "id_b": data_list[j]["id"], "point": XYZ(cross_pt.X, cross_pt.Y, z_avg)})
                continue

            # 2. SPRAWDZAMY STYK KOŃCÓW (L)
            found = False
            for p1 in [p1s, p1e]:
                for p2 in [p2s, p2e]:
                    if p1.DistanceTo(p2) < tol:
                        L.append({"id_a": data_list[i]["id"], "id_b": data_list[j]["id"], "point": p1})
                        found = True; break
                if found: break
            if found: continue

            # 3. SPRAWDZAMY TRÓJNIK (T)
            for p in [p1s, p1e]:
                if dist_pt_to_line_2d(p, p2s, p2e) < tol:
                    T.append({"id_a": data_list[i]["id"], "id_b": data_list[j]["id"], "point": p, "main_pipe": data_list[j]["id"]})
                    found = True; break
            if found: continue

            for p in [p2s, p2e]:
                if dist_pt_to_line_2d(p, p1s, p1e) < tol:
                    T.append({"id_a": data_list[j]["id"], "id_b": data_list[i]["id"], "point": p, "main_pipe": data_list[i]["id"]})
                    break
    return {"l": L, "t": T, "x": X}

def create_crosses(document, p_map, x_data):
    for item in x_data:
        r1, r2 = p_map.get(item["id_a"]), p_map.get(item["id_b"])
        pt = item["point"]
        try:
            r1b_id = PlumbingUtils.BreakCurve(document, r1.Id, pt)
            r2b_id = PlumbingUtils.BreakCurve(document, r2.Id, pt)
            document.Regenerate()
            r1b, r2b = document.GetElement(r1b_id), document.GetElement(r2b_id)
            c = [get_conn(r1, pt), get_conn(r1b, pt), get_conn(r2, pt), get_conn(r2b, pt)]
            if all(c): document.Create.NewCrossFitting(c[0], c[1], c[2], c[3])
        except: pass

def create_tees(document, p_map, t_data):
    for item in t_data:
        branch = p_map.get(item["id_a"]) if item["id_a"] != item.get("main_pipe") else p_map.get(item["id_b"])
        main = p_map.get(item.get("main_pipe"))
        pt = item["point"]
        try:
            m2_id = PlumbingUtils.BreakCurve(document, main.Id, pt)
            document.Regenerate()
            m2 = document.GetElement(m2_id)
            cb, cm1, cm2 = get_conn(branch, pt), get_conn(main, pt), get_conn(m2, pt)
            if cb and cm1 and cm2: document.Create.NewTeeFitting(cm1, cm2, cb)
        except: pass

def create_elbows(document, p_map, l_data):
    for item in l_data:
        r1, r2 = p_map.get(item["id_a"]), p_map.get(item["id_b"])
        c1, c2 = get_conn(r1, item["point"]), get_conn(r2, item["point"])
        if c1 and c2:
            try: document.Create.NewElbowFitting(c1, c2)
            except: pass

# --- WYKONANIE W GRUPIE TRANSAKCJI ---

extracted_geo = []
for item in raw_elements:
    el = force_unwrap(item)
    geom = getattr(el, "GeometryCurve", getattr(getattr(el, "Location", None), "Curve", None))
    if isinstance(geom, Line): extracted_geo.append({"id": el.Id, "curve": geom})

if extracted_geo:
    # 1. Inicjalizacja Grupy
    tg = TransactionGroup(doc, "Generowanie Systemu Rurowego")
    tg.Start()

    # 2. Transakcja na rury
    pipes_map = {}
    t_pipes = Transaction(doc, "Tworzenie Rur")
    t_pipes.Start()
    lvl_id = FilteredElementCollector(doc).OfClass(Level).FirstElementId()
    s_id, t_id = force_unwrap(raw_system).Id, force_unwrap(raw_type).Id
    for data in extracted_geo:
        p = Pipe.Create(doc, s_id, t_id, lvl_id, data["curve"].GetEndPoint(0), data["curve"].GetEndPoint(1))
        pipes_map[data["id"]] = p
    t_pipes.Commit()

    # 3. Analiza kolizji
    wyniki = analyze_intersections(extracted_geo)

    # 4. Transakcja na złączki (wszystkie typy w jednej)
    t_fittings = Transaction(doc, "Wstawianie Złączek")
    t_fittings.Start()
    
    create_crosses(doc, pipes_map, wyniki["x"])
    create_tees(doc, pipes_map, wyniki["t"])
    create_elbows(doc, pipes_map, wyniki["l"])
    
    t_fittings.Commit()

    # 5. Zamknięcie grupy (Assimilate łączy t_pipes i t_fittings w jedną pozycję Undo)
    tg.Assimilate()
    
    OUT = "Sukces: L={}, T={}, X={}".format(len(wyniki["l"]), len(wyniki["t"]), len(wyniki["x"]))
else:
    OUT = "Brak danych wejściowych."
# ----------------------------------------
watch = Watch(python_script_2)
