# Dynamo graph creates_chedule.dyn (Dynamo 3.6.1.9895)

categories = Categories("OST_DuctCurves")
code_block = CodeBlock { "Six5"; }
schedule_type = ScheduleTypes("RegularSchedule")
createSchedule = ScheduleView.CreateSchedule(category=categories, name=code_block, scheduleType=schedule_type)  # graph output
schedulableFields = ScheduleView.SchedulableFields(scheduleView=createSchedule)
name = Revit.Schedules.SchedulableField.Name(schedulableField=schedulableFields)
code_block_2 = CodeBlock { "Rodzina i typ"; "Długość"; }
list_create = List.Create(item0=code_block_2.out0, item1=code_block_2.out1)
indexOf = List.IndexOf(list=name, element=list_create)
getItemAtIndex = List.GetItemAtIndex(list=schedulableFields, index=indexOf)
addFields = ScheduleView.AddFields(scheduleView=createSchedule, fields=getItemAtIndex)
