# Dynamo graph eksport_all_schedules_tocsv.dyn (Dynamo 3.6.1.9895)

element_classes = ElementTypes("ViewSchedule")
all_elements_of_class = ElementsOfType(element_class=element_classes)

# group: wybiera ścieżke
# Opis <Kliknij dwukrotnie tutaj, aby edytować opis grupy>
directory_path = Directory("C:\Users\tomas\Desktop\schedulle")  # graph input

python_script = Python(IN[0]=all_elements_of_class, IN[1]=directory_path)  # CPython3
# ---------- python_script.python (57 lines) ----------
import clr
import os

# Import Revit API
clr.AddReference('RevitAPI')
from Autodesk.Revit.DB import *

# Pobranie danych z wejść Dynamo
input_schedules = IN[0] if isinstance(IN[0], list) else [IN[0]]
export_folder = str(IN[1])

# Sprawdzenie czy folder istnieje
if not os.path.exists(export_folder):
    os.makedirs(export_folder)

results = []

# Konfiguracja eksportu
opt = ViewScheduleExportOptions()
opt.FieldDelimiter = ","
opt.ExportHeadersFooter = False
opt.ColumnHeaders = ExportColumnHeaders.OneRow

for item in input_schedules:
    # Odpakowanie elementu z Dynamo do Revit API
    if hasattr(item, "InternalElement"):
        sched = item.InternalElement
    else:
        sched = item

    # Sprawdzenie czy to na pewno ViewSchedule (pomijamy filtr nazwy)
    if isinstance(sched, ViewSchedule):
        try:
            # Czyszczenie nazwy pliku ze znaków zakazanych
            clean_name = "".join([c for c in sched.Name if c.isalnum() or c in (' ', '_')]).strip()
            filename = clean_name + ".csv"
            full_path = os.path.join(export_folder, filename)
            
            # 1. Eksport standardowy
            sched.Export(export_folder, filename, opt)
            
            # 2. MECHANICZNE USUNIĘCIE PIERWSZEGO WIERSZA (Tytułu)
            with open(full_path, 'r') as f:
                lines = f.readlines()
            
            # Nadpisujemy plik bez pierwszej linii
            if len(lines) > 1:
                with open(full_path, 'w') as f:
                    f.writelines(lines[1:])
            
            results.append("OK (Wyczyszczono): " + filename)
        except Exception as e:
            results.append("Błąd w {}: {}".format(sched.Name, str(e)))
    else:
        results.append("Pominięto: Element nie jest zestawieniem.")

OUT = results
# ----------------------------------------
